# Grasshopper definition forma-api.gh (Grasshopper 1.0.7)
# Copyright: 2020
# plug-ins: Swiftlet, jSwan, ProceduralCS, Formicae, Kangaroo2 Components

panel = Panel("https://app.autodeskforma.eu/designmode/pro_74nzjy4r4h/03ac9e63-182e-41b2-b5af-81e7b3ee2088")
auth = Auth(Trigger=Button())
clean = CleanTree(RemoveNulls=True, RemoveInvalid=True, RemoveEmpty=False, Tree=auth)
data = Data(flatten(clean))
pipeline = GeometryPipeline(
    GroupByLayer=False,
    GroupByType=False,
    IncludeHidden=True,
    IncludeLocked=True,
    LayerFilter="Forma::Terrain",
    NameFilter="*",
    SublayerFiltering=True,
    TypeFilter=32)
pipeline_2 = GeometryPipeline(
    GroupByLayer=False,
    GroupByType=False,
    IncludeHidden=True,
    IncludeLocked=True,
    LayerFilter="Forma::Buildings",
    NameFilter="*",
    SublayerFiltering=True,
    TypeFilter=1073741880)
python = GhPythonScript()  # -> out, key, value
# ---------- python: Python ----------
import rhinoscriptsyntax as rs

ghenv.Component.Message = "x-ads-region"


key = "x-ads-region"
value = "EMEA"
# ---------- end python ----------
python_2 = GhPythonScript(url=panel)  # -> out, key, value
# ---------- python_2: Python ----------
import rhinoscriptsyntax as rs

ghenv.Component.Message = "authcontext"
urlParts = url.split("/")

key = "authcontext"
value = urlParts[-2]
# ---------- end python_2 ----------
bearer = BearerTokenAuth(Token=data)
python_3 = GhPythonScript()  # -> out, endPoint
# ---------- python_3: Python ----------
__author__ = "ARZE"
__version__ = "2024.02.14"

import rhinoscriptsyntax as rs
ghenv.Component.Message = "Wind params end point"
endPoint  = "https://developer.api.autodesk.com/forma/wind-prediction/v1alpha/parameters"
# ---------- end python_3 ----------
ch = CreateHttpHeader(Key=python.key, Value=python.value)
cqp = CreateQueryParam(Key=python_2.key, Value=python_2.value)
mesh = Mesh([pipeline_2, pipeline])
merge = Merge(Data1=bearer, Data2=ch)
mjoin = MeshJoin(Meshes=mesh)
get = GETRequest(URL=python_3.endPoint, Params=cqp, Headers=merge)  # -> Status, Content, Response
c_script = CSharpScript(x=pipeline)  # -> out, oRect, oGrid, oAnalysis; inputs x: Mesh; disabled
# ---------- c_script: C# ----------
    var rect = GetBase(x);
    var grid = GetPoints(rect);
    var analysis = GetPointsAnalysis(rect);
    oRect = rect;
    oGrid = grid;
    oAnalysis = analysis;
# ---------- c_script: C# additional code ----------
  public static Rectangle3d GetBase(Rhino.Geometry.Mesh mesh)
  {
    BoundingBox box = mesh.GetBoundingBox(false);

    double zOffset = 100;
    Point3d center = new Point3d((box.Min.X + box.Max.X) / 2, (box.Min.Y + box.Max.Y) / 2, box.Max.Z + zOffset);
    double length = 750;
    double width = 750;
    Point3d rectStart = new Point3d(center.X - length / 2, center.Y - width / 2, center.Z);
    Point3d rectEnd = new Point3d(center.X + length / 2, center.Y + width / 2, center.Z);
    Rectangle3d rect = new Rectangle3d(new Plane(center, Vector3d.ZAxis), rectStart, rectEnd);

    return rect;
  }

  public static Point3d[] GetPoints(Rectangle3d rect)
  {
    int divisions = 500;
    double spacingX = rect.Width / (divisions - 1);
    double spacingY = rect.Height / (divisions - 1);

    int arrayLength = divisions * divisions;
    Point3d[] points = new Point3d[arrayLength];
    for (int i = 0; i < divisions; i++)
    {
      for (int j = 0; j < divisions; j++)
      {
        double x = rect.Corner(0).X + (j * spacingX);
        double y = rect.Corner(0).Y + (i * spacingY);
        Point3d pt = new Point3d(x, y, rect.Corner(0).Z);
        int index = (i * divisions) + j;
        points[index] = pt;
      }
    }

    return points;
  }

  public static Point3d[] GetPointsAnalysis(Rectangle3d rect)
  {
    Point3d center = new Point3d(
      (rect.Corner(0).X + rect.Corner(2).X) / 2,
      (rect.Corner(0).Y + rect.Corner(2).Y) / 2,
      rect.Corner(0).Z);

    double desiredLength = 300; // Total length in x
    double desiredWidth = 300; // Total length in y
    int desiredPointsX = 200; // Desired number of points in x
    int desiredPointsY = 200; // Desired number of points in y

    double spacingX = desiredLength / (desiredPointsX - 1); // Spacing between points in x
    double spacingY = desiredWidth / (desiredPointsY - 1); // Spacing between points in y

    int divisionsX = desiredPointsX; // Number of divisions in x
    int divisionsY = desiredPointsY; // Number of divisions in y

    double actualLength = spacingX * (divisionsX - 1); // Actual total length in x
    double actualWidth = spacingY * (divisionsY - 1); // Actual total length in y

    // Calculate the start and end points of the new rectangle
    Point3d newRectStart = new Point3d(center.X - actualLength / 2, center.Y - actualWidth / 2, center.Z);
    Point3d newRectEnd = new Point3d(center.X + actualLength / 2, center.Y + actualWidth / 2, center.Z);
    Rectangle3d newRect = new Rectangle3d(new Plane(center, Vector3d.ZAxis), newRectStart, newRectEnd);

    Point3d[] points = new Point3d[desiredPointsX * desiredPointsY];

    for (int i = 0; i < divisionsY; i++)
    {
      for (int j = 0; j < divisionsX; j++)
      {
        double x = newRect.Corner(0).X + (j * spacingX);
        double y = newRect.Corner(0).Y + (i * spacingY);
        points[i * divisionsX + j] = new Point3d(x, y, newRect.Corner(0).Z);
      }
    }

    return points;
  }
# ---------- end c_script ----------
fg_ta = GH_terrainArrays(Terrain=pipeline, TerrainBuilding=mjoin)  # -> HeightDictionary, AnalysisMesh, Debug
panel_2 = Panel(get.Status)
dotdisplay = DotDisplay(Point=c_script.oAnalysis)  # disabled
dotdisplay_2 = DotDisplay(Point=c_script.oGrid)  # disabled
gh_postarray = GH_postArray(HeightArray=fg_ta.HeightDictionary, WindParameters=get.Content)
python_4 = GhPythonScript()  # -> out, endPoint
# ---------- python_4: Python ----------
__author__ = "ARZE"
__version__ = "2024.02.14"

import rhinoscriptsyntax as rs
ghenv.Component.Message = "Predict end point"
#endPoint  = "https://developer.api.autodesk.com/forma/wind-prediction/v1alpha/predict"
endPoint = "https://developer.api.autodesk.com/forma/wind-prediction/v1alpha/comfort/predict"
# ---------- end python_4 ----------
merge_2 = Merge(Data1=bearer, Data2=ch)
ctb = CreateTextBody(
    Content=gh_postarray,
    IsHtmlChecked=False,
    IsJavascriptChecked=False,
    IsJsonChecked=True,
    IsTextChecked=False,
    IsXmlChecked=False)
post = POSTRequest(URL=python_4.endPoint, Body=ctb, Params=cqp, Headers=merge_2)  # -> Status, Content, Response
dejson = DeserializeJson(JSON=post.Content, OutputsLocked=False)  # -> Heatmap_data, Heatmap_mask, Metadata
number_slider = Slider(1, range=0..1)
number_slider_2 = Slider(4, range=0..10)
range = Range(Domain=number_slider_2, Steps=10)
panel_3 = Panel(dejson.Heatmap_data)
gradient = Gradient(
    LowerLimit="0",
    UpperLimit=number_slider_2,
    Parameter=flatten(range),
    stops=[0: RGB(39, 72, 161), 0: RGB(16, 55, 181), 0.162: RGB(29, 146, 242), 0.324: RGB(50, 227, 218), 0.487: RGB(130, 255, 178), 0.673: RGB(204, 227, 134), 0.821: RGB(255, 154, 82), 1: RGB(255, 46, 23)])
prob = Data(fg_ta.AnalysisMesh)
recolor_mesh = RecolorMesh(
    Mesh=prob,
    Result=dejson.Heatmap_data,
    ListOfColors=gradient,
    LowerBoundary=0,
    UpperBoundary=number_slider_2,
    Segments=10)  # -> ColoredMesh, Colors, Values
