# Grasshopper definition forma-api.gh (Grasshopper 1.0.7)
# Copyright: 2024
# plug-ins: Formicae, Swiftlet

panel = Panel("https://developer.api.autodesk.com/forma/wind-prediction/v1alpha/parameters")
auth = Auth(Trigger=Button())
clean = CleanTree(RemoveNulls=True, RemoveInvalid=True, RemoveEmpty=False, Tree=auth)
data = Data(flatten(clean))
ch = CreateHttpHeader(Key="x-ads-region", Value="EMEA")
bearer = BearerTokenAuth(Token=data)
cqp = CreateQueryParam(Key="authcontext", Value="pro_74nzjy4r4h")
merge = Merge(Data1=bearer, Data2=ch)
get = GETRequest(URL=panel, Params=cqp, Headers=merge)  # -> Status, Content, Response
panel_2 = Panel(merge)
panel_3 = Panel(get.Content)
python = GhPythonScript(wind_param=get.Content)  # -> out, body_dump
# ---------- python: Python ----------
__author__ = "ARZE"
__version__ = "2024.02.13"

import rhinoscriptsyntax as rs
import json

body = dict()
type = "comfort"
#"roughness": 0.6065,
comfortScale = "lawson_lddc"


wind_param_parts = json.loads(wind_param)
roughness = wind_param_parts["roughness"]
heightMaps  = {
        "terrainHeightArray": [0 for i in range(250000)],
        "minHeight": -5.7272000915399985,
        "maxHeight": 261.58963123445756,
        "buildingAndTerrainHeightArray":[0 for i in range(250000)]
    }
    
    

    
del wind_param_parts["roughness"]


body["heightMaps"] = heightMaps
body["windRose"] = wind_param_parts
body["type"] = type
body["roughness"] = roughness
body["comfortScale"] = comfortScale

body_dump = json.dumps(body)
# ---------- end python ----------
panel_4 = Panel("https://developer.api.autodesk.com/forma/wind-prediction/v1alpha/predict")
ctb = CreateTextBody(
    Content=python.body_dump,
    IsHtmlChecked=False,
    IsJavascriptChecked=False,
    IsJsonChecked=True,
    IsTextChecked=False,
    IsXmlChecked=False)
post = POSTRequest(URL=panel_4, Body=ctb, Params=cqp, Headers=merge)  # -> Status, Content, Response
panel_5 = Panel(post.Status)
